# Grasshopper definition Digital_futures.gh (Grasshopper 1.0.6)
# plug-ins: Pufferfish, Anemone, Weaverbird, Kangaroo2 Components

brep = Brep([<brep referenced from the Rhino model> x7])
curve = Curve(<curve referenced from the Rhino model>)
plane_surface = PlaneSurface(Plane=PlaneXY(0, 0, 0), XSize=Slider(150, range=0..1000), YSize=Slider(200, range=0..1000))
loop_start = LoopStart(Repeat=Slider(3, range=0..10), Trigger=Button(), Data=curve)  # -> port, Counter, Data
curve_2 = Curve(flatten(loop_start.Data))
mesh_surface = MeshSurface(Surface=plane_surface, UCount=Slider(5, range=0..10), VCount=Slider(7, range=0..100), Overhang=True, Equalize=False)
explode = Explode(Curve=curve_2, Recursive=True)  # -> Segments, Vertices
nakedvertices = NakedVertices(Mesh=mesh_surface)  # -> ClothedIndex, NakedIndex, ClothedPts, NakedPts
divide_curve = DivideCurve(Curve=explode.Segments, Count=Slider(2, range=0..10), Kinks=False)  # -> Points, Tangents, Parameters
merge = Merge(Data1=nakedvertices.ClothedPts, Data2=nakedvertices.NakedPts)
point_in_breps = PointInBreps(Brep=brep, Point=merge, Strict=False)  # -> Inside, Index
list_item = ListItem(List=divide_curve.Points, Index=Slider(1, range=0..1), Wrap=True)  # -> flatten(Item)
dispatch = Dispatch(List=merge, DispatchPattern=point_in_breps.Inside)  # -> ListA, ListB
list_item_2 = ListItem(List=list_item, Index=Slider(2, range=0..100), Wrap=True)
list_item_3 = ListItem(List=list_item, Index=Slider(0, range=0..100), Wrap=True)
list_item_4 = ListItem(List=list_item, Index=Slider(1, range=0..100), Wrap=True)
list_item_5 = ListItem(List=list_item, Index=Slider(0, range=0..100), Wrap=True)
point = Point(dispatch.ListA)
point_2 = Point(dispatch.ListB)
polyline = PolyLine(Vertices=[list_item_3, list_item_4, list_item_2, list_item_5], Closed=False)
unit_z = UnitZ(Factor=Slider(0.295, range=0..1))
show = Show(G=mesh_surface)
load = Load(Point=point_2, ForceVector=unit_z)
edgelengths = EdgeLengths(Mesh=mesh_surface, LengthFactor=Slider(1, range=0..1), Strength=Slider(10, range=0..10))
unit_z_2 = UnitZ(Factor=Slider(100, range=0..100))
anchor = Anchor(Point=point, Strength=Slider(0.6, range=0..10))
move = Move(Geometry=polyline, Motion=unit_z_2)  # -> Geometry, Transform
merge_2 = Merge(Data1=show, Data2=edgelengths, Data3=anchor, Data4=load)  # -> flatten(Result)
loop_end = LoopEnd(
    port=loop_start.port,
    Exit=False,
    Data=[move.Geometry, curve_2],
    TimeOutVal=0,
    pausedState=False,
    state="Constant output")
range = Range(Domain=Domain(0, 1), Steps=Slider(1, range=0..100))
curve_3 = Curve(loop_end)
solver = Solver(GoalObjects=merge_2, Reset=Button(), Threshold=1e-15, Tolerance=0.01, On=Toggle(True))  # -> I, V, O
loft = Loft(Curves=curve_3, Options={Adjust=False, Closed=False, LoftEnds=0, LoftSimp=0, LoftType=0, Rebuild=10, Refit=0.01})
graph_mapper = GraphMapper(range)
list_item_6 = ListItem(List=solver.O, Index=0, Wrap=True)
mesh = Mesh(list_item_6)
duplicate_data = DuplicateData(Data=mesh, Number=2, Order=True)
xy_plane = XYPlane(Origin=Point(0, 0, 0))
mesh_2 = Mesh(duplicate_data)
mirror = Mirror(Geometry=mesh_2, Plane=xy_plane)  # -> Geometry, Transform
twisted_box_two_meshes = TwistedBoxTwoMeshes(MeshA=mesh, MeshB=mirror.Geometry, ParametersW=graph_mapper)
mesh_brep = MeshBrep(
    Brep=loft,
    Settings={GridMaxCount=0, GridMinCount=16, JaggedSeams=False, MaxEdgeLength=0, MinEdgeLength=0.0001, MinTolerance=0, Refine=True, RefineAngle=0, RelativeTolerance=0.65, SimplePlanes=True, Tolerance=0})
bounding_box = BoundingBox(Content=mesh_brep, Plane=PlaneXY(0, 0, 0))  # -> Box, Box_2
twisted_box = TwistedBox(twisted_box_two_meshes)
box_morph = BoxMorph(Geometry=mesh_brep, Reference=bounding_box.Box, Target=twisted_box)
mesh_join = MeshJoin(Meshes=box_morph)
combine_clean = CombineClean(Meshes=mesh_join)
data_dam = DataDam(DataDataA=combine_clean, BufferDelay=10000000, BufferMode=0)
weaverbird_s_picture_frame = WeaverbirdsPictureFrame(MeshPolylines=data_dam, Distance=Slider(33, range=0..100), InsetType=0)
data_dam_2 = DataDam(DataDataA=weaverbird_s_picture_frame, BufferDelay=10000000, BufferMode=0)
weaverbird_s_mesh_thicken = WeaverbirdsMeshThicken(MeshCurves=data_dam_2, Distance=Slider(0.2, range=0..1), OffsetType=Slider(1, range=0..10))
data_dam_3 = DataDam(DataDataA=weaverbird_s_mesh_thicken, BufferDelay=10000000, BufferMode=0)
weaverbird_s_catmull_clark_subdivision = WeaverbirdsCatmullClarkSubdivision(MeshCurves=data_dam_3, Level=Slider(3, range=0..10), SmoothNakedEdges=1)
create_material = CreateMaterial(
    Diffuse=ColourSwatch(SwatchColor=RGB(255, 252, 240)),
    Specular=RGB(255, 255, 255),
    Emission=RGB(0, 0, 0),
    Transparency=0,
    Shine=0)
custom_preview = CustomPreview(Geometry=weaverbird_s_catmull_clark_subdivision, Material=create_material)
